# Grasshopper definition Deployment_Figure_Face_With_Mask.gh (Grasshopper 0.9.76)
# plug-ins: MeshEdit Components, Human, Pancake

panel = Panel("D:\\Breathing\\Sims\\DummyFolder\\Nose\\")
panel_2 = Panel("cheeks_feature_8_alpha_1.2.ply")
panel_3 = Panel("Body_87_cheeks_2_1_2_K4ProcessMask")
concat = Concatenate(FragmentA=panel, FragmentB=panel_2)
pcimportfrom = ImportFrom(File=concat, LastSaveLocalization="neutral,N")  # -> Geo, Layer, ObjectAttributes
concat_2 = Concatenate(FragmentA=panel, FragmentB=panel_2)
mesh = Mesh(pcimportfrom.Geo)
concat_3 = Concatenate(FragmentA=panel, FragmentB=panel_3)
concat_4 = Concatenate(FragmentA=panel, FragmentB=panel_3)
scale = Scale(Geometry=mesh, Center=Point(0, 0, 0), Factor=0.001)  # -> Geometry, Transform
vec = VectorXYZ(XComponent=0, YComponent=0, ZComponent="3.0094")  # -> Vector, Length
concat_5 = Concatenate(FragmentA=concat_3, FragmentB=".jpg")
concat_6 = Concatenate(FragmentA=concat_4, FragmentB=".obj")
rotate = Rotate(Geometry=scale.Geometry, Angle=-1.570796327, Plane=PlaneXY(0, 0, 0))  # -> Geometry, Transform
pcimportfrom_2 = ImportFrom(File=concat_6, LastSaveLocalization="neutral,N")  # -> Geo, Layer, ObjectAttributes
move = Move(Geometry=pcimportfrom_2.Geo, Motion=vec.Vector)  # -> Geometry, Transform
panel_4 = Panel(concat_6)
msmooth = SmoothMesh(Mesh=move.Geometry, Strength=0.5, SkipNaked=True, Iterations=1)
mesh_2 = Mesh(rotate.Geometry)
mesh_3 = Mesh(msmooth)
saveview = SaveViewportToFile(Run=Toggle(True), ViewportName="Perspective", Render=False, FilePath=concat_5, ScaleFactor=1)
panel_5 = Panel(saveview)
mesh_4 = Mesh(mesh_3)
mesh_5 = Mesh(mesh_2)
demesh = DeconstructMesh(Mesh=mesh_4)  # -> Vertices, Faces, Colours, Normals
material = CreateMaterial(Diffuse=RGB(255, 105, 180), Specular=RGBA(133, 186, 253, 107), Emission=RGB(158, 188, 217), Transparency=0.7, Shine=0)
shift = ShiftList(Shift=1, Wrap=True)  # disabled
conmesh = ConstructMesh(Vertices=demesh.Vertices, Faces=demesh.Faces)
ln = Line(StartPoint=shift)  # disabled
nakededge = MeshNakedEdge(Mesh=mesh_4)  # -> V, A, B
preview = CustomPreview(Geometry=conmesh, Shader=material)
item = ListItem(List=nakededge.V, Index=nakededge.A, Wrap=True)
item_2 = ListItem(List=nakededge.V, Index=nakededge.B, Wrap=True)
ln_2 = Line(StartPoint=item, EndPoint=item_2)
join = JoinCurves(Curves=ln_2, Preserve=False)
divide = DivideCurve(Curve=reparameterize(join), Count=12000, Kinks=True)  # -> Points, Tangents, Parameters
meshcp = MeshClosestPoint(Point=divide.Points, Mesh=mesh_5)  # -> Point, Index, Parameter
dist = Distance(PointA=divide.Points, PointB=meshcp.Point)
gradient = Gradient(
    LowerLimit=Slider(0, range=0..10),
    UpperLimit=Slider(0, range=0..10),
    Parameter=dist,
    stops=[0: RGB(234, 38, 0), 0: RGB(234, 126, 0), 0: RGB(254, 244, 84), 0.676: RGB(173, 203, 249), 1: RGB(75, 107, 169)])
preview_2 = CustomPreview(Geometry=divide.Points, Shader=gradient)
